# Dynamo custom node SurfacesArranger.dyf (Dynamo 3.3.0.6316)
# category: Revit
# arranges surfaces in a table with label area and creates the table

surface = Input(surface: var[]..[])
spacing = Input(spacing: double)
columns = Input(columns: double)
labelbandsize = Input(labelbandsize: double)
Reference = Input(Reference: Revit.Elements.Element)
rotate = Python(IN[0]=surface, IN[1]=spacing, IN[2]=columns, IN[3]=labelbandsize, IN[4]=Reference)  # CPython3
# ---------- rotate.python (330 lines) ----------
# ═══════════════════════════════════════════════════════════════════════════════
# Dynamo Python Script — Grid Layout — Fixed Placement via Revit Element
# ───────────────────────────────────────────────────────────────────────────────
# IN[0] = surfaces         list of Surface / PolySurface geometry
# IN[1] = spacing          float
# IN[2] = columns          int
# IN[3] = label_band       float
# IN[4] = placement        Revit model line OR scope box element (optional)
#                          Leave disconnected → origin (0,0,0)
# ───────────────────────────────────────────────────────────────────────────────
# OUT[0] = arranged surfaces
# OUT[1] = vertical lines
# OUT[2] = horizontal lines
# OUT[3] = label center points
# OUT[4] = debug — shows exactly what origin was resolved
# ═══════════════════════════════════════════════════════════════════════════════

import clr
import math

clr.AddReference('ProtoGeometry')
from Autodesk.DesignScript.Geometry import (
    BoundingBox, Vector, CoordinateSystem, Line, Point
)

clr.AddReference('RevitAPI')
from Autodesk.Revit.DB import (
    CurveElement, LocationCurve,
    FilteredElementCollector, BuiltInCategory
)

clr.AddReference('RevitServices')
from RevitServices.Persistence import DocumentManager

clr.AddReference('RevitNodes')
import Revit
clr.ImportExtensions(Revit.GeometryConversion)

doc = DocumentManager.Instance.CurrentDBDocument

# ── Helper: flatten nested lists ──────────────────────────────────────────────
def flatten(obj):
    if isinstance(obj, list):
        for item in obj:
            for sub in flatten(item):
                yield sub
    else:
        yield obj

# ── Get Project Base Point offset in Revit internal feet ──────────────────────
def get_project_base_point_xyz():
    """
    Returns the Project Base Point as a Revit XYZ in internal feet.
    This is the offset between Revit internal origin and the PBP.
    We subtract this to get coordinates relative to PBP (= Dynamo origin).
    """
    try:
        pbp = FilteredElementCollector(doc)\
              .OfCategory(BuiltInCategory.OST_ProjectBasePoint)\
              .FirstElement()
        return pbp.get_BoundingBox(None).Min   # XYZ in feet
    except:
        return None

# ── FIXED placement origin resolver ───────────────────────────────────────────
def get_origin(raw):
    """
    The key insight from the Dynamo forum:
    - GetEndPoint() / Location.Curve returns coords from INTERNAL origin (feet)
    - Dynamo's origin IS the Project Base Point
    - So we must subtract PBP from the raw API coords
    - Then convert feet → Dynamo units using .ToPoint() (handles units correctly)

    For scope boxes:
    - Same principle: bb.Min is relative to internal origin
    - Subtract PBP, then convert with .ToPoint()
    """
    debug = []

    if raw is None:
        debug.append("No input → origin (0,0,0)")
        return (0.0, 0.0, 0.0), debug

    obj = raw
    if isinstance(obj, list):
        if len(obj) == 0:
            debug.append("Empty list → origin (0,0,0)")
            return (0.0, 0.0, 0.0), debug
        obj = obj[0]

    if obj is None:
        debug.append("None → origin (0,0,0)")
        return (0.0, 0.0, 0.0), debug

    # Get Project Base Point offset (in internal feet)
    pbp_xyz = get_project_base_point_xyz()
    if pbp_xyz:
        debug.append("PBP internal feet: x={:.6f} y={:.6f} z={:.6f}".format(
            pbp_xyz.X, pbp_xyz.Y, pbp_xyz.Z))
    else:
        debug.append("PBP not found, using 0,0,0 as offset")

    def subtract_pbp(xyz):
        """Subtract PBP from raw internal XYZ, return adjusted XYZ"""
        if pbp_xyz is None:
            return xyz
        from Autodesk.Revit.DB import XYZ
        return XYZ(xyz.X - pbp_xyz.X,
                   xyz.Y - pbp_xyz.Y,
                   xyz.Z - pbp_xyz.Z)

    # ── Unwrap Revit element ──────────────────────────────────────────────────
    revit_elem = None
    try:
        revit_elem = obj.InternalElement
        debug.append("Element type: " + revit_elem.GetType().Name)
    except Exception as e:
        debug.append("InternalElement unwrap failed: " + str(e))
        revit_elem = obj

    if revit_elem is None:
        debug.append("No element → (0,0,0)")
        return (0.0, 0.0, 0.0), debug

    # ── Model line / Detail line (CurveElement) ───────────────────────────────
    # Use Location.Curve (not GeometryCurve) — this is the correct API for
    # getting the element's actual geometry curve in model space
    # Then subtract PBP and use .ToPoint() for unit conversion
    try:
        if isinstance(revit_elem, CurveElement):
            loc = revit_elem.Location
            if isinstance(loc, LocationCurve):
                curve    = loc.Curve
                raw_xyz  = curve.GetEndPoint(0)        # feet, internal origin
                adj_xyz  = subtract_pbp(raw_xyz)       # feet, PBP-relative
                dyn_pt   = adj_xyz.ToPoint()            # Dynamo Point (project units)
                x, y, z  = float(dyn_pt.X), float(dyn_pt.Y), float(dyn_pt.Z)
                debug.append("CurveElement Location.Curve start:")
                debug.append("  raw internal feet: x={:.6f} y={:.6f}".format(raw_xyz.X, raw_xyz.Y))
                debug.append("  PBP-adjusted feet: x={:.6f} y={:.6f}".format(adj_xyz.X, adj_xyz.Y))
                debug.append("  ToPoint (dynamo):  x={:.4f} y={:.4f}".format(x, y))
                return (x, y, z), debug
    except Exception as e:
        debug.append("CurveElement failed: " + str(e))

    # ── Scope box (BoundingBoxXYZ) ────────────────────────────────────────────
    # Same fix: subtract PBP from raw internal coords, then ToPoint()
    try:
        bb = revit_elem.get_BoundingBox(None)
        if bb is not None:
            # Apply transform first (scope box local → world internal)
            world_min = bb.Transform.OfPoint(bb.Min)
            world_max = bb.Transform.OfPoint(bb.Max)

            from Autodesk.Revit.DB import XYZ
            raw_xyz = XYZ(min(world_min.X, world_max.X),
                          min(world_min.Y, world_max.Y),
                          min(world_min.Z, world_max.Z))

            adj_xyz = subtract_pbp(raw_xyz)
            dyn_pt  = adj_xyz.ToPoint()
            x, y, z = float(dyn_pt.X), float(dyn_pt.Y), float(dyn_pt.Z)

            debug.append("Scope box BoundingBox:")
            debug.append("  world internal feet: x={:.6f} y={:.6f}".format(raw_xyz.X, raw_xyz.Y))
            debug.append("  PBP-adjusted feet:   x={:.6f} y={:.6f}".format(adj_xyz.X, adj_xyz.Y))
            debug.append("  ToPoint (dynamo):    x={:.4f} y={:.4f}".format(x, y))
            return (x, y, z), debug
    except Exception as e:
        debug.append("Scope box failed: " + str(e))

    debug.append("All methods failed → (0,0,0)")
    return (0.0, 0.0, 0.0), debug

# ── Surface edge helpers ───────────────────────────────────────────────────────
def get_edges(surface):
    try:    return surface.Edges
    except:
        try: return surface.GetEdges()
        except: return []

def edge_length(edge):
    try:    return edge.Length
    except:
        try: return edge.CurveGeometry.Length
        except: return 0.0

def edge_vector(edge):
    try:    c = edge.CurveGeometry
    except: c = edge
    sp = c.StartPoint; ep = c.EndPoint
    dx = ep.X - sp.X;  dy = ep.Y - sp.Y
    L  = math.sqrt(dx*dx + dy*dy)
    return (dx/L, dy/L) if L > 1e-9 else (1.0, 0.0)

def edge_start(edge):
    try:    c = edge.CurveGeometry
    except: c = edge
    return c.StartPoint

# ── Orient surface: longest edge → +X, rests on that edge ────────────────────
def orient_surface(surface):
    edges = get_edges(surface)
    if not edges: return surface
    longest   = max(edges, key=edge_length)
    ex, ey    = edge_vector(longest)
    angle_deg = math.degrees(math.atan2(ey, ex))
    bb        = BoundingBox.ByGeometry(surface)
    cx        = (bb.MinPoint.X + bb.MaxPoint.X) * 0.5
    cy        = (bb.MinPoint.Y + bb.MaxPoint.Y) * 0.5
    center    = Point.ByCoordinates(cx, cy, 0.0)
    normal    = Vector.ByCoordinates(0, 0, 1)
    rotated   = surface.Rotate(center, normal, -angle_deg)
    bb2       = BoundingBox.ByGeometry(rotated)
    cy2       = (bb2.MinPoint.Y + bb2.MaxPoint.Y) * 0.5
    edges2    = get_edges(rotated)
    if edges2:
        longest2 = max(edges2, key=edge_length)
        edge_y   = edge_start(longest2).Y
        if cy2 < edge_y:
            cx2 = (bb2.MinPoint.X + bb2.MaxPoint.X) * 0.5
            c2  = Point.ByCoordinates(cx2, cy2, 0.0)
            rotated = rotated.Rotate(c2, normal, 180.0)
    center.Dispose(); normal.Dispose()
    return rotated

# ══════════════════════════════════════════════════════════════════════════════
# MAIN
# ══════════════════════════════════════════════════════════════════════════════
surfaces      = list(flatten(IN[0]))
spacing       = float(IN[1])
columns       = int(IN[2])
label_band    = float(IN[3])
placement_raw = IN[4] if len(IN) > 4 else None

if not surfaces:
    OUT = [[], [], [], [], "No surfaces"]; raise Exception("IN[0] empty")

(origin_x, origin_y, origin_z), debug_info = get_origin(placement_raw)

oriented = [orient_surface(s) for s in surfaces]
bboxes   = [BoundingBox.ByGeometry(s) for s in oriented]
widths   = [bb.MaxPoint.X - bb.MinPoint.X for bb in bboxes]
heights  = [bb.MaxPoint.Y - bb.MinPoint.Y for bb in bboxes]

num_surfaces = len(oriented)
num_rows     = -(-num_surfaces // columns)

col_widths = []
for c in range(columns):
    idx = [r*columns+c for r in range(num_rows) if r*columns+c < num_surfaces]
    col_widths.append(max(widths[i] for i in idx) if idx else 0.0)

row_heights = []
for r in range(num_rows):
    idx = [r*columns+c for c in range(columns) if r*columns+c < num_surfaces]
    row_heights.append(max(heights[i] for i in idx) if idx else 0.0)

margin = spacing * 0.5
col_x  = []
x_acc  = margin
for w in col_widths:
    col_x.append(x_acc); x_acc += w + spacing

row_y_log = []
y_acc = margin
for h in row_heights:
    row_y_log.append(y_acc); y_acc += h + spacing + label_band

last    = num_rows - 1
total_h = row_y_log[last] + row_heights[last] + margin + label_band + margin
fx0     = 0.0
fx1     = x_acc - spacing + margin
z       = origin_z

def wx(lx): return lx + origin_x
def wy(ly): return (total_h - ly) + origin_y

fy0 = wy(total_h)
fy1 = wy(0.0)

arranged = []
for idx, surface in enumerate(oriented):
    row = idx // columns; col = idx % columns
    mn  = bboxes[idx].MinPoint
    vec = Vector.ByCoordinates(
        wx(col_x[col]) - mn.X,
        wy(row_y_log[row] + row_heights[row]) - mn.Y,
        -mn.Z + z)
    src = CoordinateSystem.Identity()
    tgt = src.Translate(vec)
    arranged.append(surface.Transform(src, tgt))
    vec.Dispose(); tgt.Dispose()

v_lines = []
def mkv(lx):
    rx = wx(lx)
    p1 = Point.ByCoordinates(rx, fy0, z)
    p2 = Point.ByCoordinates(rx, fy1, z)
    ln = Line.ByStartPointEndPoint(p1, p2)
    p1.Dispose(); p2.Dispose(); return ln

v_lines.append(mkv(fx0)); v_lines.append(mkv(fx1))
for c in range(columns - 1):
    v_lines.append(mkv(col_x[c] + col_widths[c] + margin))

h_lines = []
def mkh(ry):
    p1 = Point.ByCoordinates(wx(fx0), ry, z)
    p2 = Point.ByCoordinates(wx(fx1), ry, z)
    ln = Line.ByStartPointEndPoint(p1, p2)
    p1.Dispose(); p2.Dispose(); return ln

h_lines.append(mkh(fy0)); h_lines.append(mkh(fy1))
label_cy = []
for r in range(num_rows):
    lyA = row_y_log[r] + row_heights[r] + margin
    lyB = lyA + label_band
    ryA = wy(lyA); ryB = wy(lyB)
    h_lines.append(mkh(ryA)); h_lines.append(mkh(ryB))
    label_cy.append((ryA + ryB) * 0.5)

label_points = []
for idx in range(num_surfaces):
    row = idx // columns; col = idx % columns
    label_points.append(Point.ByCoordinates(
        wx(col_x[col] + col_widths[col] * 0.5),
        label_cy[row], z))

OUT = [arranged, v_lines, h_lines, label_points, debug_info]
# ----------------------------------------
code_block = CodeBlock { 0; [1,2]; 3; }
getItemAtIndex = List.GetItemAtIndex(list=rotate, index=code_block.out0)
surfaces = Output(getItemAtIndex)
getItemAtIndex_2 = List.GetItemAtIndex(list=rotate, index=code_block.out1)
lines = Output(getItemAtIndex_2)
getItemAtIndex_3 = List.GetItemAtIndex(list=rotate, index=code_block.out2)
Labellocation = Output(getItemAtIndex_3)
